# Grasshopper definition GHDebugSurface.gh (Grasshopper 1.0.7)

# ---- group: SurfaceFromAGridOfPoints
srf = Surface(reparameterize(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))
srfpt = SurfacePoints(Surface=srf)  # -> Points, Weights, Greville, UCount, VCount

# ----
# NURBS Surface_Loose_Lofted surface_ All opened curves
number_slider = Slider(2, range=0..10)

# ---- group: SurfaceFrom4Points
srf4pt = _4PointSurface(CornerA="{0.0, 0.0, 0.0}", CornerB="{10.0, 0.0, 0.0}", CornerC="{10.0, 10.0, 2.0}", CornerD="{0.0, 10.0, 4.0}")  # -> reparameterize(Surface)

# ----
panel = Panel("""{-20.0, 0.0, 0.0}
{0.0, 0.0, 10.0}
{10.0, 0.0, 0.0}""")
panel_2 = Panel("""{-15.0, 10.0, 0.0}
{0.0, 10.0, 5.0}
{20.0, 10.0, 1.0}""")
panel_3 = Panel("""{-5.0, 25.0, 0.0}
{0.0, 25.0, 20.0}
{10.0, 25.0, 0.0}""")
panel_4 = Panel("""{-5.0, 35.0, -2.0}
{0.0, 35.0, 20.0}
{5.0, 35.0, 0.0}""")
panel_5 = Panel(srfpt.Weights)
panel_6 = Panel(srfpt.Points)
loft_opt = LoftOptions(Closed=False, Adjust=False, Rebuild=0, Refit=0, Type=Slider(1, range=0..10))
nurbs = NurbsCurve(Vertices=panel, Degree=number_slider, Periodic=False)  # -> Curve, Length, Domain
nurbs_2 = NurbsCurve(Vertices=panel_2, Degree=number_slider, Periodic=False)  # -> Curve, Length, Domain
nurbs_3 = NurbsCurve(Vertices=panel_3, Degree=number_slider, Periodic=False)  # -> Curve, Length, Domain
nurbs_4 = NurbsCurve(Vertices=panel_4, Degree=number_slider, Periodic=False)  # -> Curve, Length, Domain
merge = Merge(Data1=nurbs.Curve, Data2=nurbs_2.Curve, Data3=nurbs_3.Curve, Data4=nurbs_4.Curve)
panel_7 = Panel("""{0.5,0.5,0.0}
{0.1,0.1,0.0}
{1.0,1.0,0.0}""")
loft = Loft(Curves=merge, Options=loft_opt)

# ---- group: PointAt and VectorAt
# All these definitions were used to convalidate and developed the GeometrySharp surfaces tests.
panel_8 = Panel("""{0.5,0.5,0.0}
{0.1,0.1,0.0}
{1,1,0.0}
{0.3,0.5,0.0}""")
evalsrf = EvaluateSurface(Surface=srf, Point=panel_8)  # -> Point, Normal, UDirection, VDirection, Frame
panel_9 = Panel(evalsrf.VDirection)
panel_10 = Panel(evalsrf.Point)

# ---- group: RationalDerivatives
c_script = CSharpScript(srf=srf)  # -> out, derv0, dervs; inputs srf: Surface
# ---------- c_script: C# ----------
    Point3d pt;
    Vector3d[] derivis;
    srf.Evaluate(0.3, 0.5, 1, out pt, out derivis);
    dervs = derivis;
    derv0 = pt;
# ---------- end c_script ----------
panel_11 = Panel(c_script.derv0)
panel_12 = Panel(c_script.dervs)

# ----
evalsrf_2 = EvaluateSurface(Surface=reparameterize(loft), Point=panel_7)  # -> Point, Normal, UDirection, VDirection, Frame
srfpt_2 = SurfacePoints(Surface=loft)  # -> Points, Weights, Greville, UCount, VCount
panel_13 = Panel(evalsrf_2.VDirection)
panel_14 = Panel([srfpt_2.VCount, srfpt_2.UCount])
panel_15 = Panel(evalsrf_2.Point)
item = ListItem(List=panel_15, Index=Slider(3, range=0..10), Wrap=True)
panel_16 = Panel(item)
